% Requirement links of BEST.m (R2017b)

% lines 1531-1539 links to 0 best_requirements.slreqx#29: interacting with axes to add pulses on any stimulator
            function cb_stimulatorSelector(source,~)
                if(isvalid(obj.pi.mm.stimulatorSelector))
                    
                    obj.pi.mm.stimulatorSelector.Color='k';
                end
                obj.pi.mm.stim.(cd).slctd=str2double(source.Tag);
                source.Color='b';
                obj.pi.mm.stimulatorSelector=source;
            end